vi "student_LLSE.gvi"   [LabVIEW NXG]
inputs:
  "Error In": error
  "A": c128[][]
  "b": c128[]
outputs:
  "Error Out": error
  "x.estimate": c128[]
  "mean square error": f64
diagram:
  call "Solve Complex Linear Equations (single right hand).gvi"(input matrix=$A, known vector=$b) -> (solution vector=w1, error=w2)
  $"x.estimate" <- w1
  Complex Conjugate(x + iy=$b) -> w3
  call "Complex Dot Product.gvi"(x vector=w3, y vector=$b) -> (x * y=w4)
  call "Complex A x Vector.gvi"(A=$A, vector=w1) -> (A x vector=w5)
  call "Complex Dot Product.gvi"(x vector=w3, y vector=w5) -> (x * y=w6)
  Subtract(x=w4, y=w6) -> w7
  Absolute Value(x=w7) -> w8
  Square(x=w8) -> w9
  $"mean square error" <- w9
  Property Node(instance in=$"Error In", "code"=w2) -> (instance out=w10)
  $"Error Out" <- w10
