vi "student_direct_equalizer.gvi"   [LabVIEW NXG]
inputs:
  "Modulation Parameters In": T6 = {"Modulation Type"="QPSK", "Control Information\nfor Packet Header/Tail"={"Training Sequence (derived)"=[], "Zero Pad Length"=0}, "RX Oversample Factor"=20, "Synchronization Options"={"Synchronization Method"="Timing Estimation", "Fixed Offset"=0, "Symbol Timing Recovery Method"="Max Energy", "Frame Detection Method"="Sliding Correlator", "Correct Frequency Offset"=FALSE}, "Number of Data Symbols (Derived)"=100, "RX Sample Rate"=4000000, "Pulse Shaping Parameters"={"Modulation Type"="PSK", "Pulse Shaping Filter"="Root Raised Cos", "Filter Parameter"=0.5, "Filter Length (Symbols)"=8}, "Channel Estimation/Equalization Parameters"={"Equalization Method"="Direct", "Channel Estimate Length"=1, "Equalizer Length"=1, "Equalizer Delay"=-1}}
  "Input": c128[]
  "Equalizer Delay": i32
  "error in (no error)": error
outputs:
  "Modulation Parameters Out": T6
  "Filter Estimate": c128[]
  "Mean-Squared Error": f64
  "Actual Equalizer Delay": i32
  "error out": error
panel indicators:
  "Error Code": i32
types:
  T1 = cluster{"Training Sequence (derived)": c128[], "Zero Pad Length": i32}
  T2 = cluster{"Synchronization Method": string, "Fixed Offset": i32, "Symbol Timing Recovery Method": string, "Frame Detection Method": string, "Correct Frequency Offset": bool}
  T3 = enum{"none", "Raised Cosine", "Root Raised Cos", "Gaussian"}
  T4 = cluster{"Modulation Type": enum{"FSK", "PSK", "QAM", "MSK", "PAM", "ASK"}, "Pulse Shaping Filter": T3, "Filter Parameter": f64, "Filter Length (Symbols)": i32}
  T5 = cluster{"Equalization Method": string, "Channel Estimate Length": i32, "Equalizer Length": i32, "Equalizer Delay": i32}
  T6 = cluster{"Modulation Type": string, "Control Information\nfor Packet Header/Tail": T1, "RX Oversample Factor": i32, "Synchronization Options": T2, "Number of Data Symbols (Derived)": i32, "RX Sample Rate": f64, "Pulse Shaping Parameters": T4, "Channel Estimation/Equalization Parameters": T5}
diagram:
  $"Modulation Parameters Out" <- $"Modulation Parameters In"
  Property Node(instance in=$"Modulation Parameters In") -> ("Channel Estimation/Equalization Parameters:Equalizer Length"=w1, "Control Information\nfor Packet Header/Tail:Training Sequence (derived)"=w2)
  Quotient And Remainder(x=$"Equalizer Delay", y=w1) -> (x-y*floor(x/y)=w3)
  $"Actual Equalizer Delay" <- w3
  Array Size(array=w2) -> (size(s)=w4)
  Quotient And Remainder(x=w4, y=2) -> (floor(x/y)=w5)
  Array Subset(array=w2, length0=w5) -> w6
  Decrement(x=w1) -> w7
  Subtract(x=$"Equalizer Delay", y=w7) -> w8
  Array Subset(array=$Input, index0=w8, length0=w1) -> w9
  Array Subset(array=$Input, index0=$"Equalizer Delay", length0=w5) -> w10
  call "student_toeplitz.gvi"(Error In=$"error in (no error)", Row=w9, Column=w10) -> (Error Out=w11, Toeplitz Array=w12)
  call "student_LLSE.gvi"(Error In=w11, A=w12, b=w6) -> (Error Out=w13, x.estimate=w14, mean square error=w15)
  $"Filter Estimate" <- w14
  $"Mean-Squared Error" <- w15
  Property Node(instance in=w13) -> (instance out=w16, "code"=w17)
  $"error out" <- w16
  $"Error Code" <- w17
