vi "student_direct_equalizer_backup.gvi"   [LabVIEW NXG]
inputs:
  "Modulation Parameters In": T6 = {"Modulation Type"="QPSK", "Control Information\nfor Packet Header/Tail"={"Training Sequence (derived)"=[], "Zero Pad Length"=0}, "RX Oversample Factor"=20, "Synchronization Options"={"Synchronization Method"="Timing Estimation", "Fixed Offset"=0, "Symbol Timing Recovery Method"="Max Energy", "Frame Detection Method"="Sliding Correlator", "Correct Frequency Offset"=FALSE}, "Number of Data Symbols (Derived)"=100, "RX Sample Rate"=4000000, "Pulse Shaping Parameters"={"Modulation Type"="PSK", "Pulse Shaping Filter"="Root Raised Cos", "Filter Parameter"=0.5, "Filter Length (Symbols)"=8}, "Channel Estimation/Equalization Parameters"={"Equalization Method"="Direct", "Channel Estimate Length"=1, "Equalizer Length"=1, "Equalizer Delay"=-1}}
  "Input": c128[]
  "Equalizer Delay": i32
  "error in (no error)": error
outputs:
  "Modulation Parameters Out": T6
  "Filter Estimate": c128[]
  "Mean-Squared Error": f64
  "Actual Equalizer Delay": i32
  "error out": error
panel indicators:
  "Error Code": i32
types:
  T1 = cluster{"Training Sequence (derived)": c128[], "Zero Pad Length": i32}
  T2 = cluster{"Synchronization Method": string, "Fixed Offset": i32, "Symbol Timing Recovery Method": string, "Frame Detection Method": string, "Correct Frequency Offset": bool}
  T3 = enum{"none", "Raised Cosine", "Root Raised Cos", "Gaussian"}
  T4 = cluster{"Modulation Type": enum{"FSK", "PSK", "QAM", "MSK", "PAM", "ASK"}, "Pulse Shaping Filter": T3, "Filter Parameter": f64, "Filter Length (Symbols)": i32}
  T5 = cluster{"Equalization Method": string, "Channel Estimate Length": i32, "Equalizer Length": i32, "Equalizer Delay": i32}
  T6 = cluster{"Modulation Type": string, "Control Information\nfor Packet Header/Tail": T1, "RX Oversample Factor": i32, "Synchronization Options": T2, "Number of Data Symbols (Derived)": i32, "RX Sample Rate": f64, "Pulse Shaping Parameters": T4, "Channel Estimation/Equalization Parameters": T5}
diagram:
  $"Modulation Parameters Out" <- $"Modulation Parameters In"
  Property Node(instance in=$"Modulation Parameters In") -> ("Channel Estimation/Equalization Parameters:Equalizer Length"=w1, "Control Information\nfor Packet Header/Tail:Training Sequence (derived)"=w2)
  Increment(x=w1)
  Array Size(array=w2) -> (size(s)=w3)
  Divide(x=w3, y=2) -> w4
  To Long Integer(number=w4) -> w5
  Array Subset(array=w2, length0=w5) -> w6
  Subtract(x=w1, y=$"Equalizer Delay") -> w7
  for (N = w7) (iteration -> i1) {
    Add($"Equalizer Delay", i1) -> w9
    Array Index(array=$Input) -> (out0[w9]=w10)
    append w10 to w8
  }
  Array Subset(array=$Input, index0=$"Equalizer Delay", length0=w5) -> w11
  call "student_toeplitz.gvi"(Error In=$"error in (no error)", Row=w8, Column=w11) -> (Error Out=w12, Toeplitz Array=w13)
  call "student_LLSE.gvi"(Error In=w12, A=w13, b=w6) -> (Error Out=w14, x.estimate=w15, mean square error=w16)
  $"Filter Estimate" <- w15
  $"Mean-Squared Error" <- w16
  $"error out" <- w14
