vi "transmitter_apply_channel (SubVI).gvi"   [LabVIEW NXG]
inputs:
  "Channel Model Parameters": T1 = {"Noise Power (dB)"=-Inf, "Channel Response"=[], "Frequency Offset"=0, "Delay (sec)"=0, "Channel Model"="AWGN"}
  "Input Waveform": c128[]
  "Modulation Parameters In": T5 = {"Modulation Type"="QPSK", "Pulse Shaping Parameters"={"Modulation Type"="PSK", "Pulse Shaping Filter"="Raised Cosine", "Filter Parameter"=0.5, "Filter Length (Symbols)"=8}, "TX Oversample Factor"=20, "Packet Length (Bits)"=500, "TX Sample Rate"=100, "Control Information For Packet Header/Tail"={"Training Sequence "="Length 11 Barker Sequence", "Zero Pad Length"=8}}
  "error in": error
outputs:
  "Modulation Parameters Out": T5
  "Output Complex Waveform": cluster{"t0": f64, "dt": f64, "Y": c128[]}
  "Actual Delay (Sec)": f64
  "error out": error
types:
  T1 = cluster{"Noise Power (dB)": f64, "Channel Response": c128[], "Frequency Offset": f64, "Delay (sec)": f64, "Channel Model": string}
  T2 = enum{"none", "Raised Cosine", "Root Raised Cos", "Gaussian"}
  T3 = cluster{"Modulation Type": enum{"FSK", "PSK", "QAM", "MSK", "PAM", "ASK"}, "Pulse Shaping Filter": T2, "Filter Parameter": f64, "Filter Length (Symbols)": i32}
  T4 = cluster{"Training Sequence ": string, "Zero Pad Length": i32}
  T5 = cluster{"Modulation Type": string, "Pulse Shaping Parameters": T3, "TX Oversample Factor": i32, "Packet Length (Bits)": i32, "TX Sample Rate": f64, "Control Information For Packet Header/Tail": T4}
diagram:
  Property Node(instance in=$"Modulation Parameters In") -> (instance out=w1, "TX Sample Rate"=w2)
  $"Modulation Parameters Out" <- w1
  Reciprocal(x=w2) -> w3
  call "make_MTwaveform.gvi"(dt=w3, Y=$"Input Waveform") -> (output MT waveform=w4)
  call "channel.gviprotected"(Modulation Parameters In=$"Modulation Parameters In", Input Complex Waveform=w4, Channel Model Parameters=$"Channel Model Parameters", error in (no error)=$"error in") -> (Output Complex Waveform=w5, Actual Delay (Sec)=w6, error out=w7)
  $"Output Complex Waveform" <- w5
  $"Actual Delay (Sec)" <- w6
  $"error out" <- w7
