vi "simulator.gvi"   [LabVIEW NXG]
panel controls:
  "# of Iterations": i32 = 1
  "Control Information for Packet Header/Tail": T1 = {"Training Sequence Type"="Length 11 Barker Sequence", "Zero Pad Length"=8}
  "Pulse Shaping Parameters": T3 = {"Modulation Type"="PSK", "Pulse Shaping Filter"="Raised Cosine", "Filter Parameter"=0.5, "Filter Length (Symbols)"=8}
  "Packet Length (Bits)": i32 = 500
  "RX Oversample Factor": i32 = 4
  "RX Sample Rate": f64 = 4000000
  "TX Sample Rate": f64 = 4000000
  "TX Oversample Factor": i32 = 4
  "RX HW Parameters": T4 = {"Active Antenna"="RX1", "Carrier Frequency (Hz)"=915000000, "Gain (dB)"=10, "Trigger Level"=0.01, "Bandwidth (Hz)"=915000000, "Reference Position (%)"=10, "Capture Time (s)"=0.0033, "Simulate"=FALSE, "Device IP Address"="192.168.11.2"}
  "TX Channel Model Parameters": T5 = {"Noise Power (dB)"=-Inf, "Channel Response"=[], "Frequency Offset"=0, "Delay (sec)"=0, "Channel Model"="AWGN"}
  "TX HW Parameters": T6 = {"Active Antenna"="TX1", "Carrier Frequency (Hz)"=915000000, "Gain (dB)"=10, "Generation Mode"="Simulate", "Device IP Address"="192.168.11.3"}
  "Modulation Type": string = "QPSK"
  "RX Modulation Parameters": T10 = {"Modulation Type"="QPSK", "Control Information\nfor Packet Header/Tail"={"Training Sequence (derived)"=[], "Zero Pad Length"=0}, "RX Oversample Factor"=20, "Synchronization Options"={"Synchronization Method"="Timing Estimation", "Fixed Offset"=0, "Symbol Timing Recovery Method"="Max Energy", "Frame Detection Method"="Sliding Correlator", "Correct Frequency Offset"=FALSE}, "Number of Data Symbols (Derived)"=100, "RX Sample Rate"=4000000, "Pulse Shaping Parameters"={"Modulation Type"="PSK", "Pulse Shaping Filter"="Root Raised Cos", "Filter Parameter"=0.5, "Filter Length (Symbols)"=8}, "Channel Estimation/Equalization Parameters"={"Equalization Method"="Direct", "Channel Estimate Length"=1, "Equalizer Length"=1, "Equalizer Delay"=-1}}
  "Channel Estimation/Equalization Parameters": T9 = {"Equalization Method"="Direct", "Channel Estimate Length"=4, "Equalizer Length"=4, "Equalizer Delay"=-1}
  "TX Modulation Parameters": T12 = {"Modulation Type"="QPSK", "Pulse Shaping Parameters"={"Modulation Type"="PSK", "Pulse Shaping Filter"="Root Raised Cos", "Filter Parameter"=0.5, "Filter Length (Symbols)"=8}, "TX Oversample Factor"=20, "Packet Length (Bits)"=500, "TX Sample Rate"=100, "Control Information For Packet Header/Tail"={"Training Sequence "="Length 11 Barker Sequence", "Zero Pad Length"=8}}
  "Synchronization Options": T8 = {"Synchronization Method"="Timing Estimation", "Fixed Offset"=0, "Symbol Timing Recovery Method"="Max Energy", "Frame Detection Method"="Sliding Correlator", "Correct Frequency Offset"=FALSE}
  "Plots": i32
panel indicators:
  "Average Bit-Error Rate": f64
  "Error Statistic": f64
  "Estimated Offset": i32
  "error out": error
  "Received Constellation": cluster{"Element 1": f64[], "Element 2": f64[]}[]
  "Received Eye Diagram": cluster{"t0": f64, "dt": f64, "Y": f64[]}[]
  "Power Delay Profile": waveform<f64>
  "Q Data": waveform<f64>
  "I Data": waveform<f64>
  "Measured Channel Impairements": T13
types:
  T1 = cluster{"Training Sequence Type": string, "Zero Pad Length": i32}
  T2 = enum{"none", "Raised Cosine", "Root Raised Cos", "Gaussian"}
  T3 = cluster{"Modulation Type": enum{"FSK", "PSK", "QAM", "MSK", "PAM", "ASK"}, "Pulse Shaping Filter": T2, "Filter Parameter": f64, "Filter Length (Symbols)": i32}
  T4 = cluster{"Active Antenna": string, "Carrier Frequency (Hz)": f64, "Gain (dB)": f64, "Trigger Level": f64, "Bandwidth (Hz)": f64, "Reference Position (%)": f64, "Capture Time (s)": f64, "Simulate": bool, "Device IP Address": string}
  T5 = cluster{"Noise Power (dB)": f64, "Channel Response": c128[], "Frequency Offset": f64, "Delay (sec)": f64, "Channel Model": string}
  T6 = cluster{"Active Antenna": string, "Carrier Frequency (Hz)": f64, "Gain (dB)": f64, "Generation Mode": enum{"Single Shot", "Simulate", "Continuous"}, "Device IP Address": string}
  T7 = cluster{"Training Sequence (derived)": c128[], "Zero Pad Length": i32}
  T8 = cluster{"Synchronization Method": string, "Fixed Offset": i32, "Symbol Timing Recovery Method": string, "Frame Detection Method": string, "Correct Frequency Offset": bool}
  T9 = cluster{"Equalization Method": string, "Channel Estimate Length": i32, "Equalizer Length": i32, "Equalizer Delay": i32}
  T10 = cluster{"Modulation Type": string, "Control Information\nfor Packet Header/Tail": T7, "RX Oversample Factor": i32, "Synchronization Options": T8, "Number of Data Symbols (Derived)": i32, "RX Sample Rate": f64, "Pulse Shaping Parameters": T3, "Channel Estimation/Equalization Parameters": T9}
  T11 = cluster{"Training Sequence ": string, "Zero Pad Length": i32}
  T12 = cluster{"Modulation Type": string, "Pulse Shaping Parameters": T3, "TX Oversample Factor": i32, "Packet Length (Bits)": i32, "TX Sample Rate": f64, "Control Information For Packet Header/Tail": T11}
  T13 = cluster{"SNR(dB)": f64, "Channel Estimate": c128[], "Freq. Offset": f64, "Delay": f64}
diagram:
  w1 = $"# of Iterations"
  # actual delay
  Property Node(instance in=$"TX Channel Model Parameters") -> (instance out=w2, "Delay (sec)"=w3)
  Property Node(instance in=$"RX HW Parameters", "Simulate"=TRUE) -> (instance out=w4)
  Property Node(instance in=$"Control Information for Packet Header/Tail") -> ("Zero Pad Length"=w5)
  Property Node(instance in=T7 {all zero or empty}, "Zero Pad Length"=w5) -> (instance out=w6)
  # Ts
  Property Node(instance in=$"RX Modulation Parameters", "Modulation Type"=$"Modulation Type", "Pulse Shaping Parameters"=$"Pulse Shaping Parameters", "Control Information\nfor Packet Header/Tail"=w6, "RX Oversample Factor"=$"RX Oversample Factor", "Channel Estimation/Equalization Parameters"=$"Channel Estimation/Equalization Parameters", "Synchronization Options"=$"Synchronization Options", "RX Sample Rate"=$"RX Sample Rate") -> (instance out=w7)
  Property Node(instance in=$"TX Modulation Parameters", "Modulation Type"=$"Modulation Type", "Pulse Shaping Parameters"=$"Pulse Shaping Parameters", "TX Oversample Factor"=$"TX Oversample Factor", "Packet Length (Bits)"=$"Packet Length (Bits)", "Control Information For Packet Header/Tail"=$"Control Information for Packet Header/Tail", "TX Sample Rate"=$"TX Sample Rate") -> (instance out=w8)
  Property Node(instance in=$"TX HW Parameters", "Generation Mode"="Simulate") -> (instance out=w9)
  Divide(x=$"RX Oversample Factor", y=$"RX Sample Rate") -> w10
  for (N = w1) {
    # IQ Waveform
    call "top_tx.gvi"(HW Parameters=w9, Modulation Parameters=w8, Channel Model Parameters=w2) -> (error out=w13, Output IQ Waveform=w14)
    call "top_rx.gvi"(error in=w13, Received IQ Waveform=w14, HW Parameters=w4, Modulation Parameters=w7) -> (Eye Diagram=w15, Average Bit-Error Rate=w16, I Data=w17, Q Data=w18, Signal Constellation=w19, Measured Channel Impairements=w20, error out=w21, Offset=w22, Power Delay Profile=w23)
    # estimated delay
    Property Node(instance in=w20) -> ("delay"=w24)
    Subtract(x=w3, y=w24) -> w25
    # Ts
    Divide(x=w25, y=w10) -> w26
    Square(x=w26) -> w27
    $"Measured Channel Impairements" <- w20
    $"I Data" <- w17
    $"Q Data" <- w18
    $"Received Eye Diagram" <- w15
    $"Received Constellation" <- w19
    $"error out" <- w21
    $"Power Delay Profile" <- w23
    $"Estimated Offset" <- w22
    append w16 to w11
    append w27 to w12
  }
  call "Mean (DBL).gvi"(X=w12) -> (mean=w28)
  $"Error Statistic" <- w28
  call "Mean (DBL).gvi"(X=w11) -> (mean=w29)
  $"Average Bit-Error Rate" <- w29
