vi "student_sliding_correlator.gvi"   [LabVIEW NXG]
inputs:
  "Modulation Parameters": T6 = {"Modulation Type"="QPSK", "Control Information\nfor Packet Header/Tail"={"Training Sequence (derived)"=[], "Zero Pad Length"=0}, "RX oversample factor"=20, "Synchronization Options"={"Synchronization Method"="Timing Estimation", "Fixed Offset"=0, "Symbol Timing Recovery Method"="Max Energy", "Frame Detection Method"="Sliding Correlator", "Correct Frequency Offset"=FALSE}, "Number of Data Symbols (Derived)"=100, "RX Sample Rate"=4000000, "Pulse Shaping Parameters"={"Modulation Type"="PSK", "Pulse Shaping Filter"="Root Raised Cos", "Filter Parameter"=0.5, "Filter Length (Symbols)"=8}, "Channel Estimation/Equalization Parameters"={"Equalization Method"="Direct", "channel estimate length"=1, "equalizer length"=1, "equalizer delay"=-1}}
  "Input Complex Waveform": cluster{"t0": f64, "dt": f64, "Y": c128[]} = {"t0"=0, "dt"=1, "Y"=[]}
  "error in (no error)": error
outputs:
  "Output": c128[]
  "Frame Offset": i32
  "Frequency Offset": f64
  "error out": error
types:
  T1 = cluster{"Training Sequence (derived)": c128[], "Zero Pad Length": i32}
  T2 = cluster{"Synchronization Method": string, "Fixed Offset": i32, "Symbol Timing Recovery Method": string, "Frame Detection Method": string, "Correct Frequency Offset": bool}
  T3 = enum{"none", "Raised Cosine", "Root Raised Cos", "Gaussian"}
  T4 = cluster{"Modulation Type": enum{"FSK", "PSK", "QAM", "MSK", "PAM", "ASK"}, "Pulse Shaping Filter": T3, "Filter Parameter": f64, "Filter Length (Symbols)": i32}
  T5 = cluster{"Equalization Method": string, "channel estimate length": i32, "equalizer length": i32, "equalizer delay": i32}
  T6 = cluster{"Modulation Type": string, "Control Information\nfor Packet Header/Tail": T1, "RX oversample factor": i32, "Synchronization Options": T2, "Number of Data Symbols (Derived)": i32, "RX Sample Rate": f64, "Pulse Shaping Parameters": T4, "Channel Estimation/Equalization Parameters": T5}
diagram:
  Property Node(instance in=$"Modulation Parameters") -> ("Control Information\nfor Packet Header/Tail:Zero Pad Length"=w1, "Control Information\nfor Packet Header/Tail:Training Sequence (derived)"=w2, "Synchronization Options:Correct Frequency Offset"=w3)
  Property Node(instance in=$"Input Complex Waveform") -> ("Y"=w4)
  Initialize Array(element=0, size=w1) -> w5
  Build Array[ConcatenateInputs=True](w4, w5) -> w6
  Array Size(array=w2) -> (size(s)=w7)
  Decrement(x=w7) -> w8
  Array Size(array=w6) -> (size(s)=w9)
  Complex Conjugate(x + iy=w2) -> w10
  for (N = w9) (iteration -> i1) {
    # Nt-1
    # n
    for (N = w8) (iteration -> i2) {
      w12 = each element of w10
      # k
      Add(i1, i2) -> w14
      Array Index(array=w6) -> (out0[w14]=w15)
      Multiply(w15, w12) -> w16
      append w16 to w13
    }
    Add Array Elements(numeric array=w13) -> (sum=w17)
    Absolute Value(x=w17) -> w18
    Square(x=w18) -> w19
    append w19 to w11
  }
  Array Max And Min(array=w11) -> (max index(es)=w20)
  Subtract(x=w20, y=w1) -> w21
  $"Frame Offset" <- w21
  Add(w20, 0) -> w22
  case (w3) {
    frame False, Default {
      Array Subset(array=w6, index0=w22) -> w23
      call "student_moose.gvi"(Modulation Parameters=$"Modulation Parameters", Input=w23) -> (Frequency Offset=w25)
      w24 = $"error in (no error)"
    }
    frame True {
      Array Subset(array=w6, index0=w22) -> w26
      call "student_moose.gvi"(Modulation Parameters=$"Modulation Parameters", Input=w26) -> (Output=w23, Frequency Offset=w25)
      w24 = $"error in (no error)"
    }
  }
  $Output <- w23
  $"Frequency Offset" <- w25
  $"error out" <- w24
