vi "OFDM_receiver.gvi"   [LabVIEW NXG]
inputs:
  "error in (no error)": error
  "HW Parameters In": T1 = {"Device IP Address"="192.168.10.2", "Active Antenna"="RX1", "Carrier Frequency (Hz)"=915000000, "Gain (dB)"=10, "Trigger Level"=0.01, "Bandwidth (Hz)"=40000000, "Reference Position (%)"=10, "Capture Time (sec)"=0.0033, "Simulate"=FALSE}
  "Modulation Parameters In": T10 = {"Control Information\nfor Packet Header/Tail"={"Training Sequence Type"="IEEE 802.11a Short", "Training Sequence (derived)"=[], "Zero Pad Length"=0}, "RX Oversample Factor"=20, "Synchronization Options"={"Synchronization Method"="Timing Estimation", "Fixed Offset"=0, "Symbol Timing Recovery Method"="Max Energy", "Frame Detection Method"="Sliding Correlator", "Correct Frequency Offset"=FALSE}, "Number of Data Symbols (Derived)"=100, "RX Sample Rate"=4000000, "Pulse Shaping Parameters"={"Modulation Type"="PSK", "Pulse Shaping Filter"="Root Raised Cos", "Filter Parameter"=0.5, "Filter Length (Symbols)"=8}, "Channel Estimation/Equalization Parameters"={"Equalization Method"="Direct", "Channel Estimate Length"=1, "Equalizer Length"=1, "Equalizer Delay"=-1}, "Equalize Channel"=FALSE, "Modulation Type"="QPSK"}
  "Queues In": T4
  "Input Complex Waveform": cluster{"t0": f64, "dt": f64, "Y": c128[]}
  "OFDM Parameters In": T2 = {"FFT size (N)"=64, "Length of CP (Lc)"=8, "Null Tones"=[0, 30, 31, 32], "Number of OFDM Symbols (derived)"=1, "Training Sequence FFT size"=0, "Training Sequence Length of CP"=0}
outputs:
  "error out": error
  "Overhead Offset": i32
  "Bit-Error Rate": f64
  "Measured Channel Impairements": T3
  "Key Bit Sequence": u8[]
  "Offset": i32
  "HW Parameters Out": T1
  "Modulation Parameters Out": T10
  "Queues Out": T4
  "RX Waveforms Out": T11
panel indicators:
  "Symbol Rate": f64
types:
  T1 = cluster{"Device IP Address": string, "Active Antenna": string, "Carrier Frequency (Hz)": f64, "Gain (dB)": f64, "Trigger Level": f64, "Bandwidth (Hz)": f64, "Reference Position (%)": f64, "Capture Time (sec)": f64, "Simulate": bool}
  T2 = cluster{"FFT size (N)": i32, "Length of CP (Lc)": i32, "Null Tones": u32[], "Number of OFDM Symbols (derived)": i32, "Training Sequence FFT size": i32, "Training Sequence Length of CP": i32}
  T3 = cluster{"SNR(dB)": f64, "channel estimate": c128[], "freq. offset": f64, "delay": f64}
  T4 = cluster{"Key Bit Sequence Queue": Queue<u8[]>, "Training Sequence Queue": Queue<c128[]>}
  T5 = cluster{"Training Sequence Type": string, "Training Sequence (derived)": c128[], "Zero Pad Length": i32}
  T6 = cluster{"Synchronization Method": string, "Fixed Offset": i32, "Symbol Timing Recovery Method": string, "Frame Detection Method": string, "Correct Frequency Offset": bool}
  T7 = enum{"none", "Raised Cosine", "Root Raised Cos", "Gaussian"}
  T8 = cluster{"Modulation Type": enum{"FSK", "PSK", "QAM", "MSK", "PAM", "ASK"}, "Pulse Shaping Filter": T7, "Filter Parameter": f64, "Filter Length (Symbols)": i32}
  T9 = cluster{"Equalization Method": string, "Channel Estimate Length": i32, "Equalizer Length": i32, "Equalizer Delay": i32}
  T10 = cluster{"Control Information\nfor Packet Header/Tail": T5, "RX Oversample Factor": i32, "Synchronization Options": T6, "Number of Data Symbols (Derived)": i32, "RX Sample Rate": f64, "Pulse Shaping Parameters": T8, "Channel Estimation/Equalization Parameters": T9, "Equalize Channel": bool, "Modulation Type": string}
  T11 = cluster{"IQ Graph": cluster{"Element 1": f64[], "Element 2": f64[]}[], "Eye Diagram": cluster{"t0": f64, "dt": f64, "Y": f64[]}[], "Power Delay Profile": DoubleAnalogWaveform, "Magnitude Response": cluster{"Element 1": f64, "Element 2": f64}[]}
diagram:
  $"HW Parameters Out" <- $"HW Parameters In"
  case ($"error in (no error)") {
    frame No Error {
      call "receiver_init (SubVI).gvi"(Modulation Parameters In=$"Modulation Parameters In", Queues In=$"Queues In", OFDM Parameters In=$"OFDM Parameters In", Error In=$"error in (no error)") -> (Modulation Parameters Out=w4, Queues Out=w3, Symbol Rate=w5, Key Bit Sequence=w6, overhead offset=w7, OFDM Parameters Out=w8, Error Out=w9)
      call "matched_filtering.gviprotected"(Modulation Parameters In=w4, Input Complex Waveform=$"Input Complex Waveform", error in (no error)=w9) -> (Modulation Parameters Out=w10, Output Complex Waveform=w11, error out=w12)
      # key bit sequence
      call "OFDM_synchronize.gviprotected"(Modulation Parameters In=w10, Input Complex Waveform=w11, OFDM Parameters In=w8, error in (no error)=w12) -> (Modulation Parameters Out=w13, Output Complex Symbols=w14, OFDM Parameters Out=w15, error out=w16, Intermediate Complex Waveform=w17, Offset=w18, Estimated Frequency Offset=w19)
      call "OFDM_channel_estimate.gviprotected"(Modulation Parameters In=w13, Input Symbol Sequence=w14, OFDM Parameters in=w15, error in (no error)=w16) -> (Modulation Parameters Out=w20, OFDM Parameters out=w21, error out=w22, Channel Estimate=w23, Mean Square Error=w24)
      call "receiver_channel_impairments (SubVI).gvi"(Modulation Parameters=$"Modulation Parameters In", mean-squared error=w24, channel estimate=w23, offset=w18, estimated frequency offset=w19, overhead offset=w7) -> (Measured channel impairements=w25)
      # 2. Process baseband signal
      call "OFDM_strip_control.gviprotected"(Modulation Parameters In=w20, Input=w14, OFDM Parameters in=w21, error in (no error)=w22) -> (Modulation Parameters Out=w26, Data Symbols=w27, OFDM Parameters out=w28, error out=w29)
      call "OFDM_demodulator.gviprotected"(Modulation Parameters In=w26, Received Samples=w27, OFDM Parameters in=w28, channel estimate=w23, error in (no error)=w29) -> (Modulation Parameters Out=w30, Demodulated Symbols=w31, OFDM Parameters Out=w32, error out=w33, FD channel estimate=w34)
      call "decode.gviprotected"(Modulation Parameters In=w30, Input Symbols=w31, error in (no error)=w33) -> (Modulation Parameters Out=w35, Decoded Bit Stream=w36, error out=w37)
      # 3. Plot the symbol constellation and eye diagram for recovered symbols
      call "receiver_generate_waveforms (SubVI).gvi"(Modulation Parameters In=w35, Intermediate Complex Waveform=w17, Data Symbols=w31, OFDM Parameters In=w32, Measured Channel Impairements=w25, FD Channel Estimate=w34) -> (Modulation Parameters Out=w2, RX Waveforms Out=w38)
      $"RX Waveforms Out" <- w38
      # 1.Determine the number of data symbols and get the key bit sequence and training sequence from the queue
      # 2. Process baseband signal
      # 3. Plot the symbol constellation and eye diagram for recovered symbols
      # 1.Determine the number of data symbols, the symbol rate, the overhead
      # offset, and get the key bit sequence and training sequence from the queue
      $"Symbol Rate" <- w5
      call "error_detect.gviprotected"(input bit sequence=w36, key bit sequence=w6, error in (no error)=w37) -> (bit-error rate=w39, error out=w1)
      $"Bit-Error Rate" <- w39
      $"Key Bit Sequence" <- w6
      $Offset <- w18
      $"Overhead Offset" <- w7
      $"Measured Channel Impairements" <- w25
    }
    frame Error {
      w1 = $"error in (no error)"
      w2 = $"Modulation Parameters In"
      w3 = $"Queues In"
    }
  }
  $"Modulation Parameters Out" <- w2
  $"error out" <- w1
  $"Queues Out" <- w3
