vi "OFDM_simulator.gvi"   [LabVIEW NXG]
panel controls:
  "# of Iterations": i32 = 1
  "Pulse Shaping Parameters": T2 = {"Modulation Type"="PSK", "Pulse Shaping Filter"="Raised Cosine", "Filter Parameter"=0.5, "Filter Length (symbols)"=8}
  "Packet Length (bits)": i32 = 500
  "RX oversample factor": i32 = 4
  "RX Sample Rate": f64 = 4000000
  "TX Sample Rate": f64 = 4000000
  "TX Oversample Factor": i32 = 4
  "OFDM Parameters": T3 = {"FFT size (N)"=64, "Length of CP (Lc)"=8, "Null Tones"=[0, 30, 31, 32], "Number of OFDM Symbols (derived)"=1, "Training Sequence FFT size"=64, "Training Sequence Length of CP"=8}
  "Equalize Channel": bool = TRUE
  "TX HW Parameters": T4 = {"Device IP Address"="192.168.10.3", "Active Antenna"="TX1", "Carrier Frequency (Hz)"=915000000, "Gain (dB)"=10, "Generation Mode"="Single Shot"}
  "TX Modulation Parameters": T7 = {"Modulation Type"="QPSK", "Pulse Shaping Parameters"={"Modulation Type"="PSK", "Pulse Shaping Filter"="Root Raised Cos", "Filter Parameter"=0.5, "Filter Length (Symbols)"=8}, "TX Oversample Factor"=20, "Packet Length (Bits)"=500, "TX Sample Rate"=100, "Control Information For Packet Header/Tail"={"Training Sequence "="IEEE 802.11a Short", "Zero Pad Length"=8}}
  "RX Modulation Parameters": T11 = {"Control Information\nfor Packet Header/Tail"={"Training Sequence Type"="IEEE 802.11a Short", "Training Sequence (derived)"=[], "Zero Pad Length"=0}, "RX Oversample Factor"=20, "Synchronization Options"={"Synchronization Method"="Timing Estimation", "Fixed Offset"=0, "Symbol Timing Recovery Method"="Max Energy", "Frame Detection Method"="Sliding Correlator", "Correct Frequency Offset"=FALSE}, "Number of Data Symbols (Derived)"=100, "RX Sample Rate"=4000000, "Pulse Shaping Parameters"={"Modulation Type"="PSK", "Pulse Shaping Filter"="Root Raised Cos", "Filter Parameter"=0.5, "Filter Length (Symbols)"=8}, "Channel Estimation/Equalization Parameters"={"Equalization Method"="Direct", "Channel Estimate Length"=1, "Equalizer Length"=1, "Equalizer Delay"=-1}, "Equalize Channel"=FALSE, "Modulation Type"="QPSK"}
  "RX HW Parameters": T12 = {"Device IP Address"="192.168.10.2", "Active Antenna"="RX1", "Carrier Frequency (Hz)"=915000000, "Gain (dB)"=10, "Trigger Level"=0.01, "Bandwidth (Hz)"=39600000, "Reference Position (%)"=10, "Capture Time (sec)"=0.0005, "Simulate"=FALSE}
  "TX Channel Model Parameters": T13 = {"Noise Power (dB)"=-Inf, "Channel Response"=[], "Frequency Offset"=0, "Delay (sec)"=0, "Channel Model"="AWGN"}
  "Control Information For Packet Header/Tail": T6 = {"Training Sequence "="IEEE 802.11a Short", "Zero Pad Length"=8}
  "Modulation Type": string = "QPSK"
  "Synchronization Options": T9 = {"Synchronization Method"="OFDM Synchronization", "Fixed Offset"=0, "Symbol Timing Recovery Method"="Max Energy", "Frame Detection Method"="OFDM Frame & Frequency Sync", "Correct Frequency Offset"=FALSE}
  "Channel Estimation/Equalization Parameters": T10 = {"Equalization Method"="Direct", "Channel Estimate Length"=4, "Equalizer Length"=4, "Equalizer Delay"=-1}
  "Plots": i32
panel indicators:
  "Average Bit-Error Rate": f64
  "Power Delay Profile": waveform<f64>
  "Error Statistic": f64
  "Estimated Offset": i32
  "error out": error
  "Q Data": waveform<f64>
  "Received Constellation": cluster{"Element 1": f64[], "Element 2": f64[]}[]
  "Received Eye Diagram": cluster{"t0": f64, "dt": f64, "Y": f64[]}[]
  "I Data": waveform<f64>
  "Measured Channel Impairements": T14
types:
  T1 = enum{"none", "Raised Cosine", "Root Raised Cos", "Gaussian"}
  T2 = cluster{"Modulation Type": enum{"FSK", "PSK", "QAM", "MSK", "PAM", "ASK"}, "Pulse Shaping Filter": T1, "Filter Parameter": f64, "Filter Length (symbols)": i32}
  T3 = cluster{"FFT size (N)": i32, "Length of CP (Lc)": i32, "Null Tones": u32[], "Number of OFDM Symbols (derived)": i32, "Training Sequence FFT size": i32, "Training Sequence Length of CP": i32}
  T4 = cluster{"Device IP Address": string, "Active Antenna": string, "Carrier Frequency (Hz)": f64, "Gain (dB)": f64, "Generation Mode": enum{"Single Shot", "Simulate", "Continuous"}}
  T5 = cluster{"Modulation Type": enum{"FSK", "PSK", "QAM", "MSK", "PAM", "ASK"}, "Pulse Shaping Filter": T1, "Filter Parameter": f64, "Filter Length (Symbols)": i32}
  T6 = cluster{"Training Sequence ": string, "Zero Pad Length": i32}
  T7 = cluster{"Modulation Type": string, "Pulse Shaping Parameters": T5, "TX Oversample Factor": i32, "Packet Length (Bits)": i32, "TX Sample Rate": f64, "Control Information For Packet Header/Tail": T6}
  T8 = cluster{"Training Sequence Type": string, "Training Sequence (derived)": c128[], "Zero Pad Length": i32}
  T9 = cluster{"Synchronization Method": string, "Fixed Offset": i32, "Symbol Timing Recovery Method": string, "Frame Detection Method": string, "Correct Frequency Offset": bool}
  T10 = cluster{"Equalization Method": string, "Channel Estimate Length": i32, "Equalizer Length": i32, "Equalizer Delay": i32}
  T11 = cluster{"Control Information\nfor Packet Header/Tail": T8, "RX Oversample Factor": i32, "Synchronization Options": T9, "Number of Data Symbols (Derived)": i32, "RX Sample Rate": f64, "Pulse Shaping Parameters": T5, "Channel Estimation/Equalization Parameters": T10, "Equalize Channel": bool, "Modulation Type": string}
  T12 = cluster{"Device IP Address": string, "Active Antenna": string, "Carrier Frequency (Hz)": f64, "Gain (dB)": f64, "Trigger Level": f64, "Bandwidth (Hz)": f64, "Reference Position (%)": f64, "Capture Time (sec)": f64, "Simulate": bool}
  T13 = cluster{"Noise Power (dB)": f64, "Channel Response": c128[], "Frequency Offset": f64, "Delay (sec)": f64, "Channel Model": string}
  T14 = cluster{"SNR(dB)": f64, "Channel Estimate": c128[], "Freq. Offset": f64, "Delay": f64}
diagram:
  w1 = $"TX Channel Model Parameters"
  Property Node(instance in=$"RX HW Parameters", "Simulate"=TRUE) -> (instance out=w2)
  Property Node(instance in=$"TX HW Parameters", "Generation Mode"="Simulate") -> (instance out=w3)
  Property Node(instance in=w1) -> ("Delay (sec)"=w4)
  Property Node(instance in=$"Control Information For Packet Header/Tail") -> ("Zero Pad Length"=w5, "Training Sequence "=w6)
  Property Node(instance in=T8 {all zero or empty}, "Zero Pad Length"=w5, "Training Sequence Type"=w6) -> (instance out=w7)
  Property Node(instance in=$"RX Modulation Parameters", "Modulation Type"=$"Modulation Type", "Pulse Shaping Parameters"=$"Pulse Shaping Parameters", "Control Information\nfor Packet Header/Tail"=w7, "RX Oversample Factor"=$"RX oversample factor", "Channel Estimation/Equalization Parameters"=$"Channel Estimation/Equalization Parameters", "Synchronization Options"=$"Synchronization Options", "RX Sample Rate"=$"RX Sample Rate", "Equalize Channel"=$"Equalize Channel") -> (instance out=w8)
  Property Node(instance in=$"TX Modulation Parameters", "Modulation Type"=$"Modulation Type", "Pulse Shaping Parameters"=$"Pulse Shaping Parameters", "TX Oversample Factor"=$"TX Oversample Factor", "Packet Length (Bits)"=$"Packet Length (bits)", "Control Information For Packet Header/Tail"=$"Control Information For Packet Header/Tail", "TX Sample Rate"=$"TX Sample Rate") -> (instance out=w9)
  Divide(x=$"RX oversample factor", y=$"RX Sample Rate") -> w10
  w11 = $"OFDM Parameters"
  w12 = $"# of Iterations"
  for (N = w12) {
    # IQ Waveform
    call "top_ofdm_tx.gvi"(HW Parameters=w3, Modulation Parameters=w9, Channel Model Parameters=w1, OFDM Parameters=w11) -> (error out=w15, Output IQ Waveform=w16)
    call "top_ofdm_rx.gvi"(HW Parameters=w2, Modulation Parameters=w8, error in=w15, Received IQ Waveform=w16, OFDM Parameters=w11, # of Receive Iterations=1) -> (error out=w17, Measured Channel Impairements=w18, Offset=w19, Received Constellation=w20, Eye Diagram=w21, Q Data=w22, I Data=w23, Power Delay Profile=w24, Average Bit-Error Rate=w25)
    # actual delay
    # Ts
    # estimated delay
    Property Node(instance in=w18) -> (instance out=w26, "Delay"=w27)
    Subtract(x=w4, y=w27) -> w28
    Divide(x=w28, y=w10) -> w29
    Square(x=w29) -> w30
    $"error out" <- w17
    append w30 to w13
    append w25 to w14
  }
  call "Mean (DBL).gvi"(X=w13) -> (mean=w31)
  $"Error Statistic" <- w31
  $"Measured Channel Impairements" <- w26
  call "Mean (DBL).gvi"(X=w14) -> (mean=w32)
  $"Average Bit-Error Rate" <- w32
  $"I Data" <- w23
  $"Q Data" <- w22
  $"Received Eye Diagram" <- w21
  $"Received Constellation" <- w20
  $"Power Delay Profile" <- w24
  $"Estimated Offset" <- w19
