vi "student_OFDM_demodulator.gvi"   [LabVIEW NXG]
inputs:
  "Modulation Parameters In": T7 = {"Control Information\nfor Packet Header/Tail"={"Training Sequence Type"="IEEE 802.11a Short", "Training Sequence (derived)"=[], "Zero Pad Length"=0}, "RX Oversample Factor"=20, "Synchronization Options"={"Synchronization Method"="Timing Estimation", "Fixed Offset"=0, "Symbol Timing Recovery Method"="Max Energy", "Frame Detection Method"="Sliding Correlator", "Correct Frequency Offset"=FALSE}, "Number of Data Symbols (Derived)"=100, "RX Sample Rate"=4000000, "Pulse Shaping Parameters"={"Modulation Type"="PSK", "Pulse Shaping Filter"="Root Raised Cos", "Filter Parameter"=0.5, "Filter Length (Symbols)"=8}, "Channel Estimation/Equalization Parameters"={"Equalization Method"="Direct", "Channel Estimate Length"=1, "Equalizer Length"=1, "Equalizer Delay"=-1}, "Equalize Channel"=FALSE, "Modulation Type"="QPSK"}
  "Received Samples": c128[]
  "OFDM Parameters in": T1 = {"FFT size (N)"=64, "Length of CP (Lc)"=8, "Null Tones"=[0, 30, 31, 32], "Number of OFDM Symbols (derived)"=1, "Training Sequence FFT size"=0, "Training Sequence Length of CP"=0}
  "channel estimate": c128[]
  "error in (no error)": error
outputs:
  "Modulation Parameters Out": T7
  "Demodulated Symbols": c128[]
  "OFDM Parameters Out": T1
  "error out": error
  "FD channel estimate": c128[]
types:
  T1 = cluster{"FFT size (N)": i32, "Length of CP (Lc)": i32, "Null Tones": u32[], "Number of OFDM Symbols (derived)": i32, "Training Sequence FFT size": i32, "Training Sequence Length of CP": i32}
  T2 = cluster{"Training Sequence Type": string, "Training Sequence (derived)": c128[], "Zero Pad Length": i32}
  T3 = cluster{"Synchronization Method": string, "Fixed Offset": i32, "Symbol Timing Recovery Method": string, "Frame Detection Method": string, "Correct Frequency Offset": bool}
  T4 = enum{"none", "Raised Cosine", "Root Raised Cos", "Gaussian"}
  T5 = cluster{"Modulation Type": enum{"FSK", "PSK", "QAM", "MSK", "PAM", "ASK"}, "Pulse Shaping Filter": T4, "Filter Parameter": f64, "Filter Length (Symbols)": i32}
  T6 = cluster{"Equalization Method": string, "Channel Estimate Length": i32, "Equalizer Length": i32, "Equalizer Delay": i32}
  T7 = cluster{"Control Information\nfor Packet Header/Tail": T2, "RX Oversample Factor": i32, "Synchronization Options": T3, "Number of Data Symbols (Derived)": i32, "RX Sample Rate": f64, "Pulse Shaping Parameters": T5, "Channel Estimation/Equalization Parameters": T6, "Equalize Channel": bool, "Modulation Type": string}
diagram:
  Property Node(instance in=$"OFDM Parameters in") -> ("FFT size (N)"=w1, "Length of CP (Lc)"=w2, "Null Tones"=w3)
  Add(w1, w2) -> w4
  call "S2P.gviprotected"(Serial Input=$"Received Samples", Block Size=w4, error in (no error)=$"error in (no error)") -> (Parallel Output=w5, error out=w6)
  call "OFDM_remove_CP.gviprotected"(Input=w5, Length of CP (Lc)=w2) -> (Output=w7)
  for {
    w8 = each element of w7
    call "Complex FFT.gvi"(x=w8, FFT size=w1) -> (FFT {x}=w10)
    append w10 to w9
  }
  call "OFDM_FEQ.gviprotected"(Modulation Parameters In=$"Modulation Parameters In", OFDM Parameters in=$"OFDM Parameters in", input=w9, channel estimate=$"channel estimate") -> (OFDM Parameters out=w11, equalized output=w12, FD channel estimate=w13)
  $"OFDM Parameters Out" <- w11
  Property Node(instance in=$"Modulation Parameters In") -> (instance out=w14, "Number of Data Symbols (Derived)"=w15, "Equalize Channel"=w16)
  $"Modulation Parameters Out" <- w14
  $"FD channel estimate" <- w13
  Select(s=w16, t=w12, f=w9) -> w17
  call "OFDM_remove_null_tones.gviprotected"(Input=w17, Null Tones=w3, error in (no error)=w6) -> (Output=w18, error out=w19)
  call "P2S.gviprotected"(Parallel Input=w18, error in (no error)=w19) -> (Serial Output=w20, error out=w21)
  Array Subset(array=w20, length0=w15) -> w22
  $"Demodulated Symbols" <- w22
  $"error out" <- w21
