vi "student_OFDM_modulator.gvi"   [LabVIEW NXG]
inputs:
  "Input Symbols": c128[]
  "OFDM Parameters In": T1 = {"FFT size (N)"=64, "Length of CP (Lc)"=8, "Null Tones"=[0, 30, 31, 32], "Number of OFDM Symbols (derived)"=1, "Training Sequence FFT size"=0, "Training Sequence Length of CP"=0}
  "error in (no error)": error
outputs:
  "Output Symbols": c128[]
  "OFDM Parameters out": T1
  "error out": error
types:
  T1 = cluster{"FFT size (N)": i32, "Length of CP (Lc)": i32, "Null Tones": u32[], "Number of OFDM Symbols (derived)": i32, "Training Sequence FFT size": i32, "Training Sequence Length of CP": i32}
diagram:
  Property Node(instance in=$"OFDM Parameters In") -> (instance out=w1, "Null Tones"=w2, "FFT size (N)"=w3, "Length of CP (Lc)"=w4)
  $"OFDM Parameters out" <- w1
  Array Size(array=w2) -> (size(s)=w5)
  Subtract(x=w3, y=w5) -> w6
  call "S2P.gviprotected"(Serial Input=$"Input Symbols", Block Size=w6, error in (no error)=$"error in (no error)") -> (Parallel Output=w7, error out=w8)
  call "OFDM_insert_null_tones.gviprotected"(Input=w7, Null Tones=w2) -> (Output=w9)
  for {
    w10 = each element of w9
    call "Inverse Complex FFT.gvi"(FFT {x}=w10) -> (x=w12)
    append w12 to w11
  }
  call "OFDM_add_CP.gviprotected"(Input=w11, Length of CP (Lc)=w4) -> (Output=w13)
  call "P2S.gviprotected"(Parallel Input=w13, error in (no error)=w8) -> (Serial Output=w14, error out=w15)
  $"Output Symbols" <- w14
  $"error out" <- w15
