vi "symbol_timing.gvi"   [LabVIEW NXG]
inputs:
  "Modulation Parameters In": T6 = {"Modulation Type"="QPSK", "Control Information\nfor Packet Header/Tail"={"Training Sequence (derived)"=[], "Zero Pad Length"=0}, "RX Oversample Factor"=20, "Synchronization Options"={"Synchronization Method"="Timing Estimation", "Fixed Offset"=0, "Symbol Timing Recovery Method"="Max Energy", "Frame Detection Method"="Sliding Correlator", "Correct Frequency Offset"=FALSE}, "Number of Data Symbols (Derived)"=100, "RX Sample Rate"=4000000, "Pulse Shaping Parameters"={"Modulation Type"="PSK", "Pulse Shaping Filter"="Root Raised Cos", "Filter Parameter"=0.5, "Filter Length (Symbols)"=8}, "Channel Estimation/Equalization Parameters"={"Equalization Method"="Direct", "Channel Estimate Length"=1, "Equalizer Length"=1, "Equalizer Delay"=-1}}
  "Input Complex Waveform": cluster{"t0": f64, "dt": f64, "Y": c128[]} = {"t0"=0, "dt"=1, "Y"=[]}
  "error in (no error)": error
outputs:
  "Modulation Parameters Out": T6
  "Output Complex Waveform": cluster{"t0": f64, "dt": f64, "Y": c128[]}
  "Alignment Offset": f64
  "error out": error
types:
  T1 = cluster{"Training Sequence (derived)": c128[], "Zero Pad Length": i32}
  T2 = cluster{"Synchronization Method": string, "Fixed Offset": i32, "Symbol Timing Recovery Method": string, "Frame Detection Method": string, "Correct Frequency Offset": bool}
  T3 = enum{"none", "Raised Cosine", "Root Raised Cos", "Gaussian"}
  T4 = cluster{"Modulation Type": enum{"FSK", "PSK", "QAM", "MSK", "PAM", "ASK"}, "Pulse Shaping Filter": T3, "Filter Parameter": f64, "Filter Length (Symbols)": i32}
  T5 = cluster{"Equalization Method": string, "Channel Estimate Length": i32, "Equalizer Length": i32, "Equalizer Delay": i32}
  T6 = cluster{"Modulation Type": string, "Control Information\nfor Packet Header/Tail": T1, "RX Oversample Factor": i32, "Synchronization Options": T2, "Number of Data Symbols (Derived)": i32, "RX Sample Rate": f64, "Pulse Shaping Parameters": T4, "Channel Estimation/Equalization Parameters": T5}
diagram:
  case ($"error in (no error)") {
    frame No Error {
      Property Node(instance in=$"Modulation Parameters In") -> (instance out=w3, "Synchronization Options:Symbol Timing Recovery Method"=w4, "Synchronization Options:Fixed Offset"=w5, "RX Oversample Factor"=w6, "Pulse Shaping Parameters"=w7)
      # Use appropriate timing recovery method
      case (w4) {
        frame "MT Align to Ideal Symbols", Default {
          Property Node(instance in=w7) -> ("Modulation Type"=w10, "Pulse Shaping Filter"=w11, "Filter Parameter"=w12, "Filter Length (Symbols)"=w13)
          call "MT Generate Filter Coefficients.gvi"(pulse shaping filter=w11, pulse shaping samples per symbol=w6, matched samples per symbol=w6, filter parameter=w12, error in=$"error in (no error)", modulation type=w10, filter length=w13) -> (matched filter coefficients=w14, error out=w15)
          call "MT Align to Ideal Symbols (Generic).gvi"(input complex waveform=$"Input Complex Waveform", matched filter coefficients=w14, samples per symbol=w6, error in=w15) -> (output complex waveform=w8, waveform alignment offset=w9, error out=w1)
          w2 = w3
        }
        frame "Max Energy" {
          call "align_MaxEnergy.gviprotected"(Modulation Parameters In=w3, Input Complex Waveform=$"Input Complex Waveform") -> (Modulation Parameters Out=w2, Aligned Complex Waveform=w8, Alignment Offset (Samples)=w9)
          w1 = $"error in (no error)"
        }
        frame "Student Max Energy" {
          call "student_align_MaxEnergy.gvi"(Modulation Parameters In=w3, Input Complex Waveform=$"Input Complex Waveform") -> (Modulation Parameters Out=w2, Aligned Complex Waveform=w8, Alignment Offset (Samples)=w9)
          w1 = $"error in (no error)"
        }
        frame "Early-Late Gate" {
          call "align_ELgate.gviprotected"(Modulation Parameters In=w3, Input Complex Waveform=$"Input Complex Waveform") -> (Modulation Parameters Out=w2, Aligned Complex Waveform=w8, Alignment Offset (Samples)=w9)
          w1 = $"error in (no error)"
        }
        frame "Student Early-Late Gate" {
          call "student_align_ELgate.gvi"(Modulation Parameters In=w3, Input Complex Waveform=$"Input Complex Waveform") -> (Modulation Parameters Out=w2, Aligned Complex Waveform=w8, Alignment Offset (Samples)=w9)
          w1 = $"error in (no error)"
        }
        frame "Gardner" {
          call "align_Gardner.gviprotected"(Modulation Parameters In=w3, Input Complex Waveform=$"Input Complex Waveform", error in (no error)=$"error in (no error)") -> (Alignment Offset (Samples)=w9, Aligned Complex Waveform=w8, Modulation Parameters Out=w2, error out=w1)
        }
        frame "Fixed Offset" {
          Property Node(instance in=$"Input Complex Waveform") -> ("Y"=w16)
          Delete From Array(inArray=w16, length (1)=w5, index0=0) -> w17
          Property Node(instance in=$"Input Complex Waveform", "Y"=w17, "t0"=0) -> (instance out=w8)
          w1 = $"error in (no error)"
          w2 = w3
          w9 = w5
        }
      }
      Property Node(instance in=w8) -> ("Y"=w18)
      call "Decimate (single shot, CDB).gvi"(x=w18, decimating factor=w6) -> (decimated array=w19)
      # Downsample corrected signal
      Property Node(instance in=w8, "Y"=w19) -> (instance out=w20)
      $"Output Complex Waveform" <- w20
      $"Alignment Offset" <- w9
    }
    frame Error {
      w1 = $"error in (no error)"
      w2 = $"Modulation Parameters In"
    }
  }
  $"Modulation Parameters Out" <- w2
  $"error out" <- w1
