vi "student_align_ELgate.gvi"   [LabVIEW NXG]
inputs:
  "Modulation Parameters In": T6 = {"Modulation Type"="QPSK", "Control Information\nfor Packet Header/Tail"={"Training Sequence (derived)"=[], "Zero Pad Length"=0}, "RX Oversample Factor"=20, "Synchronization Options"={"Synchronization Method"="Timing Estimation", "Fixed Offset"=0, "Symbol Timing Recovery Method"="Max Energy", "Frame Detection Method"="Sliding Correlator", "Correct Frequency Offset"=FALSE}, "Number of Data Symbols (Derived)"=100, "RX Sample Rate"=4000000, "Pulse Shaping Parameters"={"Modulation Type"="PSK", "Pulse Shaping Filter"="Root Raised Cos", "Filter Parameter"=0.5, "Filter Length (Symbols)"=8}, "Channel Estimation/Equalization Parameters"={"Equalization Method"="Direct", "Channel Estimate Length"=1, "Equalizer Length"=1, "Equalizer Delay"=-1}}
  "Input Complex Waveform": cluster{"t0": f64, "dt": f64, "Y": c128[]} = {"t0"=0, "dt"=1, "Y"=[]}
  "Error In": error
outputs:
  "Modulation Parameters Out": T6
  "Aligned Complex Waveform": cluster{"t0": f64, "dt": f64, "Y": c128[]}
  "Error Out": error
  "Alignment Offset (Samples)": i32
types:
  T1 = cluster{"Training Sequence (derived)": c128[], "Zero Pad Length": i32}
  T2 = cluster{"Synchronization Method": string, "Fixed Offset": i32, "Symbol Timing Recovery Method": string, "Frame Detection Method": string, "Correct Frequency Offset": bool}
  T3 = enum{"none", "Raised Cosine", "Root Raised Cos", "Gaussian"}
  T4 = cluster{"Modulation Type": enum{"FSK", "PSK", "QAM", "MSK", "PAM", "ASK"}, "Pulse Shaping Filter": T3, "Filter Parameter": f64, "Filter Length (Symbols)": i32}
  T5 = cluster{"Equalization Method": string, "Channel Estimate Length": i32, "Equalizer Length": i32, "Equalizer Delay": i32}
  T6 = cluster{"Modulation Type": string, "Control Information\nfor Packet Header/Tail": T1, "RX Oversample Factor": i32, "Synchronization Options": T2, "Number of Data Symbols (Derived)": i32, "RX Sample Rate": f64, "Pulse Shaping Parameters": T4, "Channel Estimation/Equalization Parameters": T5}
diagram:
  Property Node(instance in=$"Modulation Parameters In") -> ("RX Oversample Factor"=w1)
  Property Node(instance in=$"Input Complex Waveform") -> ("Y"=w2)
  for (N = w1) (iteration -> i1) {
    Array Subset(array=w2, index0=i1) -> w4
    Increment(x=i1) -> w5
    Array Subset(array=w2, index0=w5) -> w6
    Complex Conjugate(x + iy=w6) -> w7
    Decrement(x=i1) -> w8
    Array Subset(array=w2, index0=w8) -> w9
    Complex Conjugate(x + iy=w9) -> w10
    Subtract(x=w7, y=w10) -> w11
    Multiply(w4, w11) -> w12
    Complex To Real Imaginary(x + iy=w12) -> (x=w13)
    Multiply(w13, 2) -> w14
    Add Array Elements(numeric array=w14) -> (sum=w15)
    append w15 to w3
  }
  Array Max And Min(array=w3) -> (min index(es)=w16)
  $"Alignment Offset (Samples)" <- w16
  $"Modulation Parameters Out" <- $"Modulation Parameters In"
  Property Node(instance in=$"Input Complex Waveform") -> (instance out=w17, "Y"=w18)
  Array Subset(array=w18, index0=w16) -> w19
  Property Node(instance in=w17, "Y"=w19)
  $"Error Out" <- $"Error In"
