vi "student_toeplitz.gvi"   [LabVIEW NXG]
inputs:
  "Error In": error
  "Row": c128[]
  "Column": c128[]
outputs:
  "Error Out": error
  "Toeplitz Array": c128[][]
diagram:
  call "Create Special Complex Matrix.gvi"(matrix type=2, input vector1=$Column, input vector2=$Row) -> (special matrix=w1, error=w2)
  Property Node(instance in=$"Error In", "code"=w2) -> (instance out=w3)
  $"Error Out" <- w3
  $"Toeplitz Array" <- w1
