vi "student_moose.gvi"   [LabVIEW NXG]
inputs:
  "Modulation Parameters": T6 = {"Modulation Type"="QPSK", "Control Information\nfor Packet Header/Tail"={"Training Sequence (derived)"=[], "Zero Pad Length"=0}, "RX Oversample Factor"=20, "Synchronization Options"={"Synchronization Method"="Timing Estimation", "Fixed Offset"=0, "Symbol Timing Recovery Method"="Max Energy", "Frame Detection Method"="Sliding Correlator", "Correct Frequency Offset"=FALSE}, "Number of Data Symbols (Derived)"=100, "RX Sample Rate"=4000000, "Pulse Shaping Parameters"={"Modulation Type"="PSK", "Pulse Shaping Filter"="Root Raised Cos", "Filter Parameter"=0.5, "Filter Length (Symbols)"=8}, "Channel Estimation/Equalization Parameters"={"Equalization Method"="Direct", "Channel Estimate Length"=1, "Equalizer Length"=1, "Equalizer Delay"=-1}}
  "Input": c128[]
  "Error In": error
outputs:
  "Error Out": error
  "Output": c128[]
  "Frequency Offset": f64
types:
  T1 = cluster{"Training Sequence (derived)": c128[], "Zero Pad Length": i32}
  T2 = cluster{"Synchronization Method": string, "Fixed Offset": i32, "Symbol Timing Recovery Method": string, "Frame Detection Method": string, "Correct Frequency Offset": bool}
  T3 = enum{"none", "Raised Cosine", "Root Raised Cos", "Gaussian"}
  T4 = cluster{"Modulation Type": enum{"FSK", "PSK", "QAM", "MSK", "PAM", "ASK"}, "Pulse Shaping Filter": T3, "Filter Parameter": f64, "Filter Length (Symbols)": i32}
  T5 = cluster{"Equalization Method": string, "Channel Estimate Length": i32, "Equalizer Length": i32, "Equalizer Delay": i32}
  T6 = cluster{"Modulation Type": string, "Control Information\nfor Packet Header/Tail": T1, "RX Oversample Factor": i32, "Synchronization Options": T2, "Number of Data Symbols (Derived)": i32, "RX Sample Rate": f64, "Pulse Shaping Parameters": T4, "Channel Estimation/Equalization Parameters": T5}
diagram:
  Property Node(instance in=$"Modulation Parameters") -> ("RX Sample Rate"=w1, "RX Oversample Factor"=w2, "Channel Estimation/Equalization Parameters:Channel Estimate Length"=w3, "Control Information\nfor Packet Header/Tail:Training Sequence (derived)"=w4)
  Divide(x=w1, y=w2) -> w5
  Reciprocal(x=w5) -> w6
  Array Size(array=w4) -> (size(s)=w7)
  Quotient And Remainder(x=w7, y=2) -> (floor(x/y)=w8)
  Decrement(x=w3) -> w9
  Complex Conjugate(x + iy=$Input) -> w10
  Decrement(x=w8) -> w11
  Subtract(x=w11, y=w9) -> w12
  for (N = w12) (iteration -> i1) {
    # Nt-1
    # L
    Add(w9, i1) -> w14
    Array Index(array=w10) -> (out0[w14]=w15)
    Add(w8, w14) -> w16
    Array Index(array=$Input) -> (out0[w16]=w17)
    Multiply(w15, w17) -> w18
    append w18 to w13
  }
  Add Array Elements(numeric array=w13) -> (sum=w19)
  Complex To Polar(r * e^(i*theta)=w19) -> (theta=w20)
  Multiply(PiTimes2, w8) -> w21
  Divide(x=w20, y=w21) -> w22
  Divide(x=w22, y=w6) -> w23
  $"Frequency Offset" <- w23
  Array Size(array=$Input) -> (size(s)=w24)
  for (N = w24) (iteration -> i2) {
    w25 = each element of $Input
    Multiply(w22, 0-1i, PiTimes2, i2) -> w27
    Exponential(x=w27) -> w28
    Multiply(w25, w28) -> w29
    append w29 to w26
  }
  $Output <- w26
  $"Error Out" <- $"Error In"
