vi "student_align_ELgate.gvi"   [LabVIEW NXG]
inputs:
  "Modulation Parameters In": T6 = {"Modulation Type"="QPSK", "Control Information\nfor Packet Header/Tail"={"Training Sequence (derived)"=[], "Zero Pad Length"=0}, "RX Oversample Factor"=20, "Synchronization Options"={"Synchronization Method"="Timing Estimation", "Fixed Offset"=0, "Symbol Timing Recovery Method"="Max Energy", "Frame Detection Method"="Sliding Correlator", "Correct Frequency Offset"=FALSE}, "Number of Data Symbols (Derived)"=100, "RX Sample Rate"=4000000, "Pulse Shaping Parameters"={"Modulation Type"="PSK", "Pulse Shaping Filter"="Root Raised Cos", "Filter Parameter"=0.5, "Filter Length (Symbols)"=8}, "Channel Estimation/Equalization Parameters"={"Equalization Method"="Direct", "Channel Estimate Length"=1, "Equalizer Length"=1, "Equalizer Delay"=-1}}
  "Input Complex Waveform": cluster{"t0": f64, "dt": f64, "Y": c128[]} = {"t0"=0, "dt"=1, "Y"=[]}
  "Error In": error
outputs:
  "Modulation Parameters Out": T6
  "Aligned Complex Waveform": cluster{"t0": f64, "dt": f64, "Y": c128[]}
  "Error Out": error
  "Alignment Offset (Samples)": i32
types:
  T1 = cluster{"Training Sequence (derived)": c128[], "Zero Pad Length": i32}
  T2 = cluster{"Synchronization Method": string, "Fixed Offset": i32, "Symbol Timing Recovery Method": string, "Frame Detection Method": string, "Correct Frequency Offset": bool}
  T3 = enum{"none", "Raised Cosine", "Root Raised Cos", "Gaussian"}
  T4 = cluster{"Modulation Type": enum{"FSK", "PSK", "QAM", "MSK", "PAM", "ASK"}, "Pulse Shaping Filter": T3, "Filter Parameter": f64, "Filter Length (Symbols)": i32}
  T5 = cluster{"Equalization Method": string, "Channel Estimate Length": i32, "Equalizer Length": i32, "Equalizer Delay": i32}
  T6 = cluster{"Modulation Type": string, "Control Information\nfor Packet Header/Tail": T1, "RX Oversample Factor": i32, "Synchronization Options": T2, "Number of Data Symbols (Derived)": i32, "RX Sample Rate": f64, "Pulse Shaping Parameters": T4, "Channel Estimation/Equalization Parameters": T5}
diagram:
  $"Modulation Parameters Out" <- $"Modulation Parameters In"
  Property Node(instance in=$"Modulation Parameters In") -> ("RX Oversample Factor"=w1)
  Property Node(instance in=$"Input Complex Waveform") -> ("Y"=w2)
  for (N = w1) (iteration -> i1) {
    Array Subset(array=w2, index0=i1) -> w4
    call "Decimate (single shot, CDB).gvi"(x=w4, decimating factor=w1) -> (decimated array=w5)
    Increment(x=i1) -> w6
    Array Subset(array=w2, index0=w6) -> w7
    call "Decimate (single shot, CDB).gvi"(x=w7, decimating factor=w1) -> (decimated array=w8)
    Complex Conjugate(x + iy=w8) -> w9
    Decrement(x=i1) -> w10
    Array Subset(array=w2, index0=w10) -> w11
    call "Decimate (single shot, CDB).gvi"(x=w11, decimating factor=w1) -> (decimated array=w12)
    Complex Conjugate(x + iy=w12) -> w13
    Subtract(x=w9, y=w13) -> w14
    Multiply(w5, w14) -> w15
    Complex To Real Imaginary(x + iy=w15) -> (x=w16)
    Multiply(w16, 2) -> w17
    Add Array Elements(numeric array=w17) -> (sum=w18)
    append w18 to w3
  }
  Array Max And Min(array=w3) -> (min index(es)=w19)
  $"Alignment Offset (Samples)" <- w19
  Property Node(instance in=$"Input Complex Waveform") -> (instance out=w20, "Y"=w21)
  Array Subset(array=w21, index0=w19) -> w22
  Property Node(instance in=w20, "Y"=w22) -> (instance out=w23)
  $"Aligned Complex Waveform" <- w23
  $"Error Out" <- $"Error In"
